# Grasshopper definition 160407_CityMatrix.gh (Grasshopper 0.9.76)
# plug-ins: Python Interpreter, gHowl, HDTReference, LunchBox

# ---- group: mesh coloring
com_color = ColourSwatch(SwatchColor=RGB(255, 122, 122))
com_gray = ColourSwatch(SwatchColor=RGB(171, 171, 171))
res_color = ColourSwatch(SwatchColor=RGB(251, 255, 122))
mesh = Mesh([<mesh referenced from the Rhino model> x2])
sidewalk = ColourSwatch(SwatchColor=RGB(107, 107, 107))
bikelane = ColourSwatch(SwatchColor=RGB(86, 135, 87))
res_gray = ColourSwatch(SwatchColor=RGB(227, 227, 227))
parking = ColourSwatch(SwatchColor=RGB(196, 156, 100))
blank = ColourSwatch(SwatchColor=RGB(110, 110, 110))
road = ColourSwatch(SwatchColor=RGB(64, 64, 64))
park = ColourSwatch(SwatchColor=RGB(165, 201, 44))
# 3D City Grid System
text = ColourSwatch(SwatchColor=RGB(0, 0, 0))
mcol = MeshColours(Mesh=mesh, Colours=bikelane)
mesh_2 = Mesh(mcol)

# ---- group: shrink
cell_shrink = Slider(0.95, range=0.75..1)

# ---- group: module meshes lego ref: -1
mesh_3 = Mesh(<mesh referenced from the Rhino model>)

# ---- group: module meshes lego ref: 0 to 5
mesh_4 = Mesh([<mesh referenced from the Rhino model> x6])

# ---- group: colortizer orgin
# CityMatrix
# 
# by Yan "Ryan" Zhang <ryanz@mit.edu>
# for MIT Media Lab, Changing Place Group, CityScope Project
# March.17th.2016
# LEGO Grid System
pt = Point(<point referenced from the Rhino model>)

# ---- group: module meshes lego ref: 6 line bike
mesh_5 = Mesh(<mesh referenced from the Rhino model>)  # disabled

# ---- group: table size ref pt
pt_2 = Point(<point referenced from the Rhino model>)

# ---- group: module meshes lego ref: 6 line car
mesh_6 = Mesh(<mesh referenced from the Rhino model>)  # disabled

# ----
panel = Panel("7002")  # disabled
# PEVs
panel_2 = Panel("127.0.0.1")  # disabled

# ---- group: 3D building site move amount
X = UnitX(Factor="10000")

# ----
swatch = ColourSwatch(SwatchColor=RGB(255, 255, 255))  # disabled
# Traffic Heatmap
# Energy per Capita Heatmap
panel_3 = Panel("C:\Users\RYAN\Documents\GitHub\CityMatrix\Map\PEV_PSG AND PKG_300DPI.png")  # disabled
panel_4 = Panel("0.01")  # disabled
mesh_7 = Mesh(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)  # disabled
xy = XYPlane(Origin=pt)
dist = Distance(PointA=pt, PointB=pt_2)
timer = Timer(TimerInterval=500, Target=division)  # disabled

# ---- group: 6 intersect bike
mesh_8 = Mesh(<mesh referenced from the Rhino model>)  # disabled

# ---- group: 6 intersect car
mesh_9 = Mesh(<mesh referenced from the Rhino model>)  # disabled

# ---- group: udp receiver
udp = UDPReceiver(Address=panel_2, Port=panel, Pattern=0)  # -> Info, Data; disabled

# ----
_4_commed = Slider(12, range=1..25)
_1_resmed = Slider(12, range=1..25)
_3_comhq = Slider(6, range=1..25)
_0_reslux = Slider(5, range=1..25)
_5_rescw = Slider(23, range=1..25)
_2_resmu = Slider(23, range=1..25)

# ---- group: private car / road quator 0s
mesh_10 = Mesh([<mesh referenced from the Rhino model> x4])
pt_3 = Point(<point referenced from the Rhino model>)

# ---- group: base cplane
pln = Plane(xy)

# ----
movetoorgin = MoveToOrgin(G=mesh_3, num=cell_shrink)
movetoorgin_2 = MoveToOrgin(G=mesh_4, num=cell_shrink)
vec = Vector(X)
split = TextSplit(Text=udp.Data)  # disabled

# ---- group: PEV center pt
pt_4 = Point(split)  # disabled

# ----
vec2pt = Vector2Pt(PointA=Point(0, 0, 0), PointB=pt_4, Unitize=False)  # -> Vector, Length; disabled
move = Move(Geometry=mesh_7, Motion=vec2pt.Vector)  # -> Geometry, Transform; disabled
com = ColourSwatch(SwatchColor=RGB(158, 158, 158))
res = ColourSwatch(SwatchColor=RGB(212, 212, 212))
mjoin = MeshJoin(Meshes=move.Geometry)  # disabled

# ---- group: private car / road quator 1s
mesh_11 = Mesh([<mesh referenced from the Rhino model> x4])
pt_5 = Point(<point referenced from the Rhino model>)

# ---- group: private car
scale_nu = ScaleNU(Geometry=mesh_10, Plane=pt_3, ScaleX=cell_shrink, ScaleY=cell_shrink, ScaleZ=1)  # -> Geometry, Transform
scale_nu_2 = ScaleNU(Geometry=mesh_11, Plane=pt_5, ScaleX=cell_shrink, ScaleY=cell_shrink, ScaleZ=1)  # -> Geometry, Transform

# ----
merge = Merge(Data1=_0_reslux, Data2=_1_resmed, Data3=_2_resmu, Data4=_3_comhq, Data5=_4_commed, Data6=_5_rescw)
merge_2 = Merge(Data1=res, Data2=res, Data3=res, Data4=com, Data5=com, Data6=com)

# ---- group: PEVs
previewmat = CustomPreviewMaterials(Geometry=mjoin, DiffuseColor=swatch, Transparency=panel_4, DiffuseBitmap=panel_3)  # disabled

# ---- group: module meshes lego at orgin
mesh_12 = Mesh(movetoorgin_2)

mesh_13 = Mesh(movetoorgin)

# ---- group: PEV / road quator 0s
mesh_14 = Mesh([<mesh referenced from the Rhino model> x4])
pt_6 = Point(<point referenced from the Rhino model>)

# ---- group: color for each type
col = Colour(merge_2)

# ---- group: floor num for each type
int = Integer(merge)

# ---- group: floor height
panel_5 = Panel("3.5")

# ---- group: PEV / road quator 1s
mesh_15 = Mesh([<mesh referenced from the Rhino model> x4])
pt_7 = Point(<point referenced from the Rhino model>)

# ---- group: PEV
scale_nu_3 = ScaleNU(Geometry=mesh_14, Plane=pt_6, ScaleX=cell_shrink, ScaleY=cell_shrink, ScaleZ=1)  # -> Geometry, Transform
scale_nu_4 = ScaleNU(Geometry=mesh_15, Plane=pt_7, ScaleX=cell_shrink, ScaleY=cell_shrink, ScaleZ=1)  # -> Geometry, Transform

# ----
multiplication = Multiplication(A=int, B=panel_5)

# ---- group: base height
panel_6 = Panel("5.0")

# ---- group: building height for each type
num = Number(multiplication)

# ---- group: translate example
pt_8 = Point(Point(-15, -8, 0))  # disabled
python = PythonScript(point=pt_8)  # -> out, output; inputs point: Point3d; disabled
# ---------- python: Python ----------
import Rhino

transform = Rhino.Geometry.Transform.Translation(0,0,5)
point.Transform(transform)

output = point
# ---------- end python ----------

# ----
panel_7 = Panel(num)
panel_8 = Panel("6")  # disabled
panel_9 = Panel("7")  # disabled
panel_10 = Panel("216 Pearl St. Cambridge")
number_slider = Slider(10, range=10..100)
panel_11 = Panel("C:\Users\RYAN\Documents\GitHub\CityMatrix\Data\colortizer_data_rhino_02_YZ.txt")
panel_12 = Panel("C:\Users\RYAN\Documents\GitHub\CityMatrix\Data\colortizer_data_sample.txt")
# Parsing Colortizer Data (CityMatrix 16x16)
panel_13 = Panel("C:\Users\RYAN\Documents\GitHub\CityMatrix\Data\colortizer_data.txt")

# ---- group: meshes lego ref: parking
mesh_16 = Mesh(<mesh referenced from the Rhino model>)

# ----
panel_14 = Panel("C:\Users\RYAN\Documents\GitHub\CityMatrix\Data\colortizer_data_rhino_01_YZ.txt")

# ---- group: meshes lego ref: park
mesh_17 = Mesh(<mesh referenced from the Rhino model>)

# ----
Z = UnitZ(Factor=number_slider)
msphereex = MeshSphereEx(Base=Z, Radius=number_slider, Count=Slider(5, range=0..10))
Z_2 = UnitZ(Factor=Slider(6, range=0..10))
movetoorgin_3 = MoveToOrgin(G=mesh_16, num=cell_shrink)
movetoorgin_4 = MoveToOrgin(G=mesh_17, num=cell_shrink)
move_2 = Move(Geometry=msphereex, Motion=Z_2)  # -> Geometry, Transform

# ---- group: udp receiver
udp_2 = UDPReceiver(Address="127.0.0.1", Port="7001", Pattern=0)  # -> Info, Data

# ----
tree_scale = Slider(0.81, range=0.5..2)
mcol_2 = MeshColours(Mesh=move_2.Geometry, Colours=park)
split_2 = TextSplit(Text=udp_2.Data)

# ---- group: module meshes lego at orgin
mesh_18 = Mesh(movetoorgin_3)

# ---- group: reading txt
file = ReadFile(File=panel_11, PerLineParse=True)

# ---- group: module meshes lego at orgin
mesh_19 = Mesh(movetoorgin_4)

# ----
shift = ShiftList(List=split_2, Shift=1, Wrap=False)

# ---- group: meshes 3D ref: Tree
mesh_20 = Mesh(mcol_2)

# ---- group: overwrite toggle 1 - trans mode
transportation_mode = BooleanToggle(True)

# ---- group: toggle1
bool = Boolean(transportation_mode)

bool_2 = Boolean(bool)

# ----
filter = StreamFilter(Gate=bool_2, Stream0=scale_nu.Geometry, Stream1=scale_nu_3.Geometry)
filter_2 = StreamFilter(Gate=bool_2, Stream0=scale_nu_2.Geometry, Stream1=scale_nu_4.Geometry)
mesh_21 = Mesh(filter_2)
mesh_22 = Mesh(filter)
filter_3 = StreamFilter(Gate=bool_2, Stream0=pt_3, Stream1=pt_6)
filter_4 = StreamFilter(Gate=bool_2, Stream0=pt_5, Stream1=pt_7)
pt_9 = Point(filter_4)
pt_10 = Point(filter_3)

# ---- group: 3D building site move amount
vec_2 = Vector(X)

# ----
tree = Slider(2.13, range=0..5)

# ---- group: colortizer data
txt = Text(shift)

# ----
panel_15 = Panel(txt)

# ---- group: parking cell #
parking_cell = Slider(39, range=0..50)

# ---- group: total parking cell number
# Parking & Park
int_2 = Integer(parking_cell)

# ----
split_3 = SplitList(List=txt, Index=9)  # -> ListA, ListB
multiplication_2 = Multiplication(A="3", B=tree)
multiplication_3 = Multiplication(A="3", B=tree)
dom = ConstructDomain(DomainStart=multiplication_2, DomainEnd=multiplication_3)
pshift = ShiftPaths(Data=split_3.ListB, Offset=-1)
pshift_2 = ShiftPaths(Data=split_3.ListA, Offset=-1)

# ---- group: park cell #
park_cell = Slider(7, range=0..50)

# ---- group: total park cell number
int_3 = Integer(park_cell)

# ----
item = ListItem(List=pshift_2, Index=4, Wrap=False)
item_2 = ListItem(List=pshift_2, Index=2, Wrap=False)
item_3 = ListItem(List=pshift_2, Index=3, Wrap=False)
item_4 = ListItem(List=pshift_2, Index=5, Wrap=False)
item_5 = ListItem(List=pshift_2, Index=6, Wrap=False)
item_6 = ListItem(List=pshift_2, Index=7, Wrap=False)
item_7 = ListItem(List=pshift_2, Index=1, Wrap=False)
item_8 = ListItem(List=pshift_2, Index=0, Wrap=False)
item_9 = ListItem(List=pshift_2, Index=8, Wrap=False)
split_4 = TextSplit(Text=item, Separators="\t")
split_5 = TextSplit(Text=item_2, Separators="\t")
split_6 = TextSplit(Text=item_3, Separators="\t")
split_7 = TextSplit(Text=item_4, Separators="\t")
split_8 = TextSplit(Text=item_5, Separators="\t")
split_9 = TextSplit(Text=item_6, Separators="\t")
split_10 = TextSplit(Text=item_7, Separators="\t")
split_11 = TextSplit(Text=item_8, Separators="\t")
split_12 = TextSplit(Text=item_9, Separators="\t")

# ---- group: Micro-unit Building #
int_4 = Integer()

# ---- group: Regular residential Building #
int_5 = Integer()

# ---- group: Co-working Building #
int_6 = Integer()

# ---- group: Regular Office Building #
int_7 = Integer()

# ---- group: Luxury Building #
int_8 = Integer()

# ---- group: Head Quater Building #
int_9 = Integer()

# ----
pshift_3 = ShiftPaths(Data=split_4, Offset=1)
pshift_4 = ShiftPaths(Data=split_5, Offset=1)
pshift_5 = ShiftPaths(Data=split_6, Offset=1)
pshift_6 = ShiftPaths(Data=split_7, Offset=1)
pshift_7 = ShiftPaths(Data=split_8, Offset=1)
pshift_8 = ShiftPaths(Data=split_9, Offset=1)
pshift_9 = ShiftPaths(Data=split_10, Offset=1)
pshift_10 = ShiftPaths(Data=split_11, Offset=1)
pshift_11 = ShiftPaths(Data=split_12, Offset=1)
item_10 = ListItem(List=pshift_3, Index=0, Wrap=False)
item_11 = ListItem(List=pshift_4, Index=0, Wrap=False)
item_12 = ListItem(List=pshift_5, Index=0, Wrap=False)
item_13 = ListItem(List=pshift_6, Index=0, Wrap=False)
item_14 = ListItem(List=pshift_7, Index=0, Wrap=False)
item_15 = ListItem(List=pshift_8, Index=0, Wrap=False)
item_16 = ListItem(List=pshift_9, Index=0, Wrap=False)
item_17 = ListItem(List=pshift_10, Index=0, Wrap=False)
item_18 = ListItem(List=pshift_11, Index=0, Wrap=False)
ma = MassAddition(Input=[int_4, int_5, int_8])  # -> Result, PartialResults
ma_2 = MassAddition(Input=[int_6, int_7, int_9])  # -> Result, PartialResults
txt_2 = Text(item_10)
txt_3 = Text(item_11)
txt_4 = Text(item_12)
txt_5 = Text(item_13)
txt_6 = Text(item_14)
txt_7 = Text(item_15)
txt_8 = Text(item_16)
txt_9 = Text(item_17)
txt_10 = Text(item_18)
panel_16 = Panel(txt_2)
panel_17 = Panel(txt_3)
panel_18 = Panel(txt_4)
panel_19 = Panel(txt_5)
panel_20 = Panel(txt_6)
panel_21 = Panel(txt_7)
panel_22 = Panel(txt_8)
panel_23 = Panel(txt_9)
panel_24 = Panel(txt_10)

# ---- group: total residential ppl #
int_10 = Integer(ma.Result)

# ---- group: total working ppl #
int_11 = Integer(ma_2.Result)

# ----
item_19 = ListItem(List=pshift_3, Index=1, Wrap=False)

# ---- group: dockRotation
int_12 = Integer(item_19)

int_13 = Integer(item_19)

# ----
item_20 = ListItem(List=pshift_4, Index=1, Wrap=False)
item_21 = ListItem(List=pshift_5, Index=1, Wrap=False)

# ---- group: dockID
int_14 = Integer(item_21)

int_15 = Integer(item_21)

# ----
item_22 = ListItem(List=pshift_6, Index=1, Wrap=False)

# ---- group: slider1
num_2 = Number(item_22)

num_3 = Number(item_22)

# ----
item_23 = ListItem(List=pshift_7, Index=1, Wrap=False)

# ---- group: toggle1
bool_3 = Boolean(item_23)

bool_4 = Boolean(item_23)

# ----
panel_25 = Panel(bool_4)
item_24 = ListItem(List=pshift_8, Index=1, Wrap=False)

# ---- group: toggle2
bool_5 = Boolean(item_24)

bool_6 = Boolean(item_24)

# ----
item_25 = ListItem(List=pshift_9, Index=1, Wrap=False)

# ---- group: gridExtent_x
int_16 = Integer(item_25)

int_17 = Integer(item_25)

# ----
division = Division(A=dist, B=int_16)

# ---- group: cell size
num_4 = Number(division)

num_5 = Number(division)

# ----
division_2 = Division(A=num_5, B=2)
multiplication_4 = Multiplication(A=division_2, B=Slider(0.95, range=0..1))
neg = Negative(Value=multiplication_4)
dom_2 = ConstructDomain(DomainStart=neg, DomainEnd=multiplication_4)

# ---- group: gridExtent_x
# Dashboard
int_18 = Integer(item_25)

# ---- group: cell size
num_6 = Number(division)

# ----
division_3 = Division(A=num_6, B=2.5)
neg_2 = Negative(Value=division_3)
dom_3 = ConstructDomain(DomainStart=neg_2, DomainEnd=division_3)
item_26 = ListItem(List=pshift_10, Index=1, Wrap=False)
item_27 = ListItem(List=pshift_11, Index=1, Wrap=False)

# ---- group: toggle2
bool_7 = Boolean(item_27)

# Human Interaction
bool_8 = Boolean(item_27)

# ---- group: dockRotation
int_19 = Integer(item_19)

# ---- group: IDMax
int_20 = Integer(item_20)

# ---- group: dockID
int_21 = Integer(item_21)

# ---- group: slider1
num_7 = Number(item_22)

# ---- group: toggle1
bool_9 = Boolean(item_23)

# ---- group: toggle2
bool_10 = Boolean(item_24)

# ---- group: gridExtent_x
int_22 = Integer(item_25)

# ---- group: gridIndex
int_23 = Integer(item_26)

# ---- group: toggle2
bool_11 = Boolean(item_27)

# ----
panel_26 = Panel(int_19)
panel_27 = Panel(int_20)
panel_28 = Panel(int_21)
panel_29 = Panel(num_7)
panel_30 = Panel(bool_9)
panel_31 = Panel(bool_10)
panel_32 = Panel(int_22)
panel_33 = Panel(int_23)
panel_34 = Panel(bool_11)
item_28 = ListItem(List=pshift_9, Index=2, Wrap=False)

# ---- group: gridExtent_y
int_24 = Integer(item_28)

int_25 = Integer(item_28)

int_26 = Integer(item_28)

int_27 = Integer(item_28)

# ----
panel_35 = Panel(int_27)
subtraction = Subtraction(A=int_22, B=1)
multiplication_5 = Multiplication(A=int_22, B=int_27)
split_13 = SplitList(List=pshift, Index=multiplication_5)  # -> ListA, ListB
pshift_12 = ShiftPaths(Data=split_13.ListA, Offset=-1)
split_14 = TextSplit(Text=pshift_12, Separators="\t")
pshift_13 = ShiftPaths(Data=split_14, Offset=1)

# ---- group: all data
int_28 = Integer(pshift_13)

# ----
panel_36 = Panel(int_28)
item_29 = ListItem(List=int_28, Index="3", Wrap=False)
item_30 = ListItem(List=int_28, Index="0", Wrap=False)
item_31 = ListItem(List=int_28, Index="1", Wrap=False)
item_32 = ListItem(List=int_28, Index="2", Wrap=False)
pshift_14 = ShiftPaths(Data=item_30, Offset=-1)
pshift_15 = ShiftPaths(Data=item_31, Offset=-1)
pshift_16 = ShiftPaths(Data=item_32, Offset=-1)
pshift_17 = ShiftPaths(Data=item_29, Offset=-1)
neg_3 = Negative(Value=pshift_17)

# ---- group: module id
int_29 = Integer(pshift_14)

int_30 = Integer(int_29)

int_31 = Integer(int_29)

# ----
larger = LargerThan(FirstNumber=int_30, SecondNumber="0")  # -> LargerThan, OrEqualTo
smaller = SmallerThan(FirstNumber=int_30, SecondNumber="5")  # -> SmallerThan, OrEqualTo
and = GateAnd(A=larger.OrEqualTo, B=smaller.OrEqualTo)

# ---- group: is building or not
bool_12 = Boolean(and)

# ----
dispatch = Dispatch(List=int_30, DispatchPattern=bool_12)  # -> ListA, ListB

# ---- group: building id
int_32 = Integer(dispatch.ListA)

# ----
larger_2 = LargerThan(FirstNumber=int_31, SecondNumber="0")  # -> LargerThan, OrEqualTo
smaller_2 = SmallerThan(FirstNumber=int_31, SecondNumber="5")  # -> SmallerThan, OrEqualTo
item_33 = ListItem(List=col, Index=graft(int_32), Wrap=False)
and_2 = GateAnd(A=larger_2.OrEqualTo, B=smaller_2.OrEqualTo)
pshift_18 = ShiftPaths(Data=item_33, Offset=-1)
dispatch_2 = Dispatch(List=int_31, DispatchPattern=and_2)  # -> ListA, ListB
smaller_3 = SmallerThan(FirstNumber=int_31, SecondNumber="0")  # -> SmallerThan, OrEqualTo
item_34 = ListItem(List=mesh_12, Index=graft(dispatch_2.ListA), Wrap=False)

# ---- group: color for each building
col_2 = Colour(pshift_18)

# ----
item_35 = ListItem(List=panel_7, Index=graft(int_32), Wrap=False)
pshift_19 = ShiftPaths(Data=item_34, Offset=-1)
pshift_20 = ShiftPaths(Data=item_35, Offset=-1)

# ---- group: building height of each building
num_8 = Number(pshift_20)

# ----
addition = Addition(A=num_8, B=panel_6)
dom_4 = ConstructDomain(DomainStart=0, DomainEnd=addition)
equals = Equality(FirstNumber=int_31, SecondNumber=panel_9)  # -> Equality, Inequality; disabled
equals_2 = Equality(FirstNumber=int_31, SecondNumber=panel_8)  # -> Equality, Inequality; disabled
or = GateOr(A=equals_2.Equality, B=equals.Equality)  # disabled

# ---- group: module id
int_33 = Integer(int_29)

# ----
equals_3 = Equality(FirstNumber=int_33, SecondNumber="0")  # -> Equality, Inequality
equals_4 = Equality(FirstNumber=int_33, SecondNumber="1")  # -> Equality, Inequality
equals_5 = Equality(FirstNumber=int_33, SecondNumber="3")  # -> Equality, Inequality
equals_6 = Equality(FirstNumber=int_33, SecondNumber="2")  # -> Equality, Inequality
equals_7 = Equality(FirstNumber=int_33, SecondNumber="4")  # -> Equality, Inequality
equals_8 = Equality(FirstNumber=int_33, SecondNumber="5")  # -> Equality, Inequality
int_34 = Integer(equals_3.Equality)
int_35 = Integer(equals_4.Equality)
int_36 = Integer(equals_5.Equality)
int_37 = Integer(equals_6.Equality)
int_38 = Integer(equals_7.Equality)
int_39 = Integer(equals_8.Equality)
ma_3 = MassAddition(Input=int_34)  # -> Result, PartialResults
ma_4 = MassAddition(Input=int_35)  # -> Result, PartialResults
ma_5 = MassAddition(Input=int_36)  # -> Result, PartialResults
ma_6 = MassAddition(Input=int_37)  # -> Result, PartialResults
ma_7 = MassAddition(Input=int_38)  # -> Result, PartialResults
ma_8 = MassAddition(Input=int_39)  # -> Result, PartialResults
int_40 = Integer(ma_3.Result)
panel_37 = Panel(int_40)
int_41 = Integer(ma_4.Result)
panel_38 = Panel(int_41)
int_42 = Integer(ma_5.Result)
panel_39 = Panel(int_42)
int_43 = Integer(ma_6.Result)
panel_40 = Panel(int_43)
int_44 = Integer(ma_7.Result)
panel_41 = Panel(int_44)
int_45 = Integer(ma_8.Result)
panel_42 = Panel(int_45)

# ---- group: Micro-unit Building #
int_46 = Integer(int_40)

# ---- group: Regular residential Building #
int_47 = Integer(int_41)

# ---- group: Co-working Building #
int_48 = Integer(int_42)

# ---- group: Regular Office Building #
int_49 = Integer(int_44)

# ---- group: Luxury Building #
int_50 = Integer(int_43)

# ---- group: Head Quater Building #
int_51 = Integer(int_45)

# ---- group: y
int_52 = Integer(pshift_16)

int_53 = Integer(int_52)

int_54 = Integer(int_52)

int_55 = Integer(int_52)

# ---- group: rotation
int_56 = Integer(neg_3)

int_57 = Integer(int_56)

int_58 = Integer(int_56)

# ----
dispatch_3 = Dispatch(List=int_58, DispatchPattern=and_2)  # -> ListA, ListB
rotate = Rotate(Geometry=pshift_19, Angle=degrees(dispatch_3.ListA), Plane=PlaneXY(0, 0, 0))  # -> Geometry, Transform

# ---- group: rotation
int_59 = Integer(int_56)

# ----
subtraction_2 = Subtraction(A=subtraction, B=pshift_15)

# ---- group: x
int_60 = Integer(subtraction_2)

int_61 = Integer(int_60)

int_62 = Integer(int_60)

# ---- group: road check matrix
python_2 = PythonScript(xe=int_16, ye=int_24, x=int_62, y=int_54, id=int_31)  # -> out, m; inputs x: list, y: list, id: list
# ---------- python_2: Python ----------
"""
CityMatrix

written by "Ryan" Yan Zhang <ryanz@mit.edu>
for MIT Media Lab, Changing Place Group
April.6th.2016
"""

import rhinoscriptsyntax as rs

m = [[-1 for n in range(xe)] for n in range(ye)]

for n in range(len(id)):
    if id[n] == 7:
        m[y[n]][x[n]] = 6
    else:
        m[y[n]][x[n]] = id[n]

for n in range(ye):
    print m[n]
# ---------- end python_2 ----------

# ----
modulecenter = ModuleCenter(pt=pt, num=num_4, int_2=int_62, int=int_54)  # -> pt_5, transform_2

# ---- group: road check list
python_3 = PythonScript(xe=int_16, ye=int_24, x=int_62, y=int_54, id=int_31, m=python_2.m)  # -> out, rdType; inputs x: list, y: list, id: list, m: list
# ---------- python_3: Python ----------
"""
CityMatrix

written by "Ryan" Yan Zhang <ryanz@mit.edu>
for MIT Media Lab, Changing Place Group
April.6th.2016
"""

import rhinoscriptsyntax as rs

rdType = []

for n in range(len(id)):
    
    code = []
    
    if id[n]==6 or id[n]==7:
        
        # 0: check x, y+1
        if y[n]+1>ye-1:
            code.append(1)
        else:
            if m[y[n]+1][x[n]]==6:
                code.append(1)
            else:
                code.append(0)
        
        # 1: check x+1, y
        if x[n]+1>xe-1:
            code.append(1)
        else:
            if m[y[n]][x[n]+1]==6:
                code.append(1)
            else:
                code.append(0)
        
        # 2: check x, y-1
        if y[n]-1<0:
            code.append(1)
        else:
            if m[y[n]-1][x[n]]==6:
                code.append(1)
            else:
                code.append(0)
        
        # 3: check x-1, y
        if x[n]-1<0:
            code.append(1)
        else:
            if m[y[n]][x[n]-1]==6:
                code.append(1)
            else:
                code.append(0)
    
    else:
        
        code = [0,0,0,0]
    
    print code
    rdType.append(code)
# ---------- end python_3 ----------

# ----
xform = Transform(modulecenter.transform_2)  # disabled

# ---- group: module center
pt_11 = Point(modulecenter.pt_5)

pt_12 = Point(pt_11)

# ----
dispatch_4 = Dispatch(List=pt_12, DispatchPattern=bool_12)  # -> ListA, ListB

# ---- group: road check list
python_4 = PythonScript(pt=pt_11, id=int_31, rdType=python_3.rdType, rdQua0=mesh_22, c0=pt_10, rdQua1=mesh_21, c1=pt_9)  # -> out, allRoadMesh; inputs pt: list, id: list, rdType: list, rdQua0: list, rdQua1: list
# ---------- python_4: Python ----------
"""
CityMatrix

written by "Ryan" Yan Zhang <ryanz@mit.edu>
for MIT Media Lab, Changing Place Group
April.6th.2016
"""

import rhinoscriptsyntax as rs
import Rhino.Geometry as rg

allRoadMesh = []

for n in range(len(id)):
    
    if id[n]==6 or id[n]==7:
        
        for i in range(len(rdType[n])):
            t = rdType[n][i]
            v = rs.PointCoordinates(pt[n])
            if t == 0:
                c = rs.PointCoordinates(c0)
                vx = v[0]-c[0]
                vy = v[1]-c[1]
                new = rs.CopyObject(rdQua0[i],(vx,vy,0.))
            else:
                c = rs.PointCoordinates(c1)
                vx = v[0]-c[0]
                vy = v[1]-c[1]
                new = rs.CopyObject(rdQua1[i],(vx,vy,0.))
            allRoadMesh.append(new)
# ---------- end python_4 ----------

# ---- group: road mesh final!
mesh_23 = Mesh(python_4.allRoadMesh)

# ---- group: building center
pt_13 = Point(dispatch_4.ListA)

# ----
move_3 = Move(Geometry=mesh_23, Motion=vec)  # -> Geometry, Transform
box = DomainBox(Base=pt_13, X=dom_2, Y=dom_2, Z=dom_4)
dispatch_5 = Dispatch(List=pt_11, DispatchPattern=smaller_3.SmallerThan)  # -> ListA, ListB
vec2pt_2 = Vector2Pt(PointA=Point(0, 0, 0), PointB=dispatch_5.ListA, Unitize=False)  # -> Vector, Length
move_4 = Move(Geometry=box, Motion=vec)  # -> Geometry, Transform
dispatch_6 = Dispatch(List=pt_11, DispatchPattern=and_2)  # -> ListA, ListB
move_5 = Move(Geometry=mesh_13, Motion=vec2pt_2.Vector)  # -> Geometry, Transform

# ---- group: building geo
box_2 = Box(move_4.Geometry)

# ---- group: textured buildings
panel_43 = Panel("C:\Users\RYAN\Documents\GitHub\CityMatrix\Map\PEV_PSG AND PKG_300DPI.png")  # disabled
panel_44 = Panel("0.01")  # disabled
swatch_2 = ColourSwatch(SwatchColor=RGB(255, 255, 255))  # disabled
boxmap = BoxMapping(Mesh=box_2, Box=box_2)  # disabled
previewmat_2 = CustomPreviewMaterials(Geometry=boxmap, DiffuseColor=swatch_2, Transparency=panel_44, DiffuseBitmap=panel_43)  # disabled

# ----
vec2pt_3 = Vector2Pt(PointA=Point(0, 0, 0), PointB=dispatch_6.ListA, Unitize=False)  # -> Vector, Length
move_6 = Move(Geometry=rotate.Geometry, Motion=vec2pt_3.Vector)  # -> Geometry, Transform
dispatch_7 = Dispatch(List=pt_11, DispatchPattern=or)  # -> ListA, ListB; disabled

# ---- group: building lego modules
mesh_24 = Mesh(move_6.Geometry)

# ---- group: road mesh final!
mesh_25 = Mesh(python_4.allRoadMesh)

# ---- group: blank
mesh_26 = Mesh(move_5.Geometry)

mesh_27 = Mesh(mesh_26)

# ----
move_7 = Move(Geometry=mesh_27, Motion=vec)  # -> Geometry, Transform

# ---- group: 3D Buldings
preview = CustomPreview(Geometry=box_2, Shader=col_2)

# ---- group: blank
mesh_28 = Mesh(move_7.Geometry)

# ---- group: road
mesh_29 = Mesh(move_3.Geometry)

# ---- group: road center pts
pt_14 = Point(dispatch_7.ListA)  # disabled

# ---- group: x
int_63 = Integer(int_60)

# ---- group: blank modules
mesh_30 = Mesh(mesh_26)

# ----
geobottomcenter = GeoBottomCenter_2(geo=mesh_30)
lng = ListLength(List=geobottomcenter)
division_4 = Division(A=int_2, B=lng)
randomsplit = RandomSplitList(MasterList=geobottomcenter, Seed=Slider(32, range=0..100), Split=division_4)  # -> ListA, ListB
lng_2 = ListLength(List=randomsplit.ListA)
division_5 = Division(A=int_3, B=lng_2)
randomsplit_2 = RandomSplitList(MasterList=randomsplit.ListA, Seed=Slider(25, range=0..100), Split=division_5)  # -> ListA, ListB

# ---- group: parking center
pt_15 = Point(randomsplit.ListB)

# ---- group: park center lego
pt_16 = Point(randomsplit_2.ListB)

# ----
move_8 = Move(Geometry=pt_16, Motion=vec_2)  # -> Geometry, Transform

# ---- group: park center 3D
pt_17 = Point(move_8.Geometry)

# ----
planesrf = PlaneSurface(Plane=pt_17, XSize=dom_3, YSize=dom_3)
lng_3 = ListLength(List=pt_17)
random = Random(Range="0.8 to 1.4", Number=lng_3, Seed=Slider(72, range=0..100))
multiplication_6 = Multiplication(A=random, B=tree_scale)
scale = Scale(Geometry=mesh_20, Center=Point(0, 0, 0), Factor=multiplication_6)  # -> Geometry, Transform
random_2 = Random(Range=dom, Number=lng_3, Seed=Slider(17, range=0..100))
random_3 = Random(Range=Domain(0, 1000), Number=lng_3, Seed=Slider(35, range=0..100))
vec2pt_4 = Vector2Pt(PointA=Point(0, 0, 0), PointB=pt_16, Unitize=False)  # -> Vector, Length
vec2pt_5 = Vector2Pt(PointA=Point(0, 0, 0), PointB=pt_15, Unitize=False)  # -> Vector, Length
popgeo = PopulateGeometry(Geometry=flatten(planesrf), Count=flatten(random_2), Seed=flatten(random_3))
move_9 = Move(Geometry=mesh_19, Motion=vec2pt_4.Vector)  # -> Geometry, Transform
move_10 = Move(Geometry=mesh_18, Motion=vec2pt_5.Vector)  # -> Geometry, Transform

# ---- group: tree center
pt_18 = Point(flatten(popgeo))

# ----
vec2pt_6 = Vector2Pt(PointA=Point(0, 0, 0), PointB=pt_18, Unitize=False)  # -> Vector, Length
move_11 = Move(Geometry=scale.Geometry, Motion=vec2pt_6.Vector)  # -> Geometry, Transform

# ---- group: parking lego
mesh_31 = Mesh(move_9.Geometry)

# ----
move_12 = Move(Geometry=mesh_31, Motion=vec_2)  # -> Geometry, Transform

# ---- group: parking 3D
mesh_32 = Mesh(move_12.Geometry)

# ---- group: parking lego
mesh_33 = Mesh(move_10.Geometry)

# ----
move_13 = Move(Geometry=mesh_33, Motion=vec_2)  # -> Geometry, Transform

# ---- group: parking 3D
mesh_34 = Mesh(move_13.Geometry)

# ---- group: trees 3D
mesh_35 = Mesh(move_11.Geometry)

# ----
panel_45 = Panel(int_60)
panel_46 = Panel(int_52)
panel_47 = Panel(int_56)
panel_48 = Panel(int_29)

# ---- group: total cell #
int_64 = Integer(multiplication_5)

# ----
panel_49 = Panel(int_64)

# ---- group: sticky rotations
python_5 = PythonScript(x=int_56)  # -> out, rotations; inputs x: list; disabled
# ---------- python_5: Python ----------
"""
Realtime Simulator

written by Yan "Ryan" Zhang <ryanz@mit.edu>
for MIT Media Lab, Changing Place Group, CityScope Project
March.7th.2016
"""

import scriptcontext as sc

sc.sticky["rotations"] = x

rotations = sc.sticky["rotations"]
# ---------- end python_5 ----------

# ---- group: sticky y steps
python_6 = PythonScript(x=int_52)  # -> out, ySteps; inputs x: list; disabled
# ---------- python_6: Python ----------
"""
Realtime Simulator

written by Yan "Ryan" Zhang <ryanz@mit.edu>
for MIT Media Lab, Changing Place Group, CityScope Project
March.7th.2016
"""

import scriptcontext as sc

sc.sticky["ySteps"] = x

ySteps = sc.sticky["ySteps"]
# ---------- end python_6 ----------

# ---- group: sticky moduleIDs
python_7 = PythonScript(x=int_29)  # -> out, moduleIDs; inputs x: list; disabled
# ---------- python_7: Python ----------
"""
Realtime Simulator

written by Yan "Ryan" Zhang <ryanz@mit.edu>
for MIT Media Lab, Changing Place Group, CityScope Project
March.7th.2016
"""

import scriptcontext as sc

sc.sticky["moduleIDs"] = x

moduleIDs = sc.sticky["moduleIDs"]
# ---------- end python_7 ----------

# ---- group: sticky x steps
python_8 = PythonScript(x=int_60)  # -> out, xSteps; inputs x: list; disabled
# ---------- python_8: Python ----------
"""
Realtime Simulator

written by Yan "Ryan" Zhang <ryanz@mit.edu>
for MIT Media Lab, Changing Place Group, CityScope Project
March.7th.2016
"""

import scriptcontext as sc

sc.sticky["xSteps"] = x

xSteps = sc.sticky["xSteps"]
# ---------- end python_8 ----------

# ----
panel_50 = Panel(python_5.rotations)  # disabled
panel_51 = Panel(python_5.out)  # disabled
panel_52 = Panel(python_6.ySteps)  # disabled
panel_53 = Panel(python_6.out)  # disabled
panel_54 = Panel(python_8.xSteps)  # disabled
panel_55 = Panel(python_8.out)  # disabled
panel_56 = Panel(python_7.moduleIDs)  # disabled
panel_57 = Panel(python_7.out)  # disabled
amenities = PythonScript(N=Slider(30000, range=700..30000))  # -> out, A
# ---------- amenities: Python ----------
import math

title = ["density","subway_station","department_store","embassy","beauty_salon","police","courthouse","cemetery","pharmacy","local_government_office","shopping_mall","city_hall","rv_park","shoe_store","bank","bowling_alley","school","bar","university","car_dealer","taxi_stand","grocery_or_supermarket","fire_station","church","convenience_store","campground","lawyer","parking","post_office","hindu_temple","hardware_store","meal_takeaway","movie_rental","gas_station","funeral_home","aquarium","restaurant","home_goods_store","atm","veterinary_care","airport","locksmith","bus_station","hospital","night_club","electrician","mosque","amusement_park","lodging","florist","liquor_store","museum","car_rental","stadium","store","hair_care","transit_station","meal_delivery","gym","park","dentist","library","book_store","painter","roofing_contractor","moving_company","clothing_store","furniture_store","physiotherapist","casino","art_gallery","car_wash","movie_theater","spa","accounting","cafe","car_repair","synagogue","real_estate_agency","electronics_store","doctor","bicycle_store","storage","zoo","train_station","jewelry_store","laundry","insurance_agency","plumber","pet_store","bakery","travel_agency"]

newyork = [27673,10,6,10,74,3,0,0,29,27,16,0,0,28,111,2,35,200,6,13,0,20,2,13,23,1,200,89,6,0,0,74,5,0,0,0,200,102,183,2,1,7,41,22,60,16,0,0,140,12,7,9,7,0,200,60,51,28,35,13,135,31,18,5,1,28,200,21,46,1,26,1,35,39,200,96,18,0,200,105,200,2,11,0,0,200,29,200,9,2,37,177]
atlanta = [700,0,0,0,15,0,0,0,3,2,1,0,0,2,4,0,4,31,1,0,0,2,1,5,3,0,200,10,0,0,1,4,0,1,0,0,46,13,7,1,0,0,11,8,7,0,0,0,5,0,1,1,0,0,59,15,11,2,7,0,25,0,0,2,1,1,8,7,2,0,3,1,0,11,8,9,3,0,22,3,58,0,0,0,0,0,6,22,2,2,2,4]

ratio = (N - atlanta[0]) / float(newyork[0] - atlanta[0])
print ratio

amenities = {}

for i in range(len(title))[1:]:
    amenity =  title[i]
    num =  math.floor(atlanta[i]+(newyork[i]-atlanta[i]) * ratio)
    
    if title[i].startswith('law'): continue
    if title[i].startswith('jew'): continue
    if title[i].startswith('accoun'): continue
    if title[i].startswith('store'): continue
    if title[i].startswith('travel'): continue
    if title[i].startswith('cloth'): continue
    if title[i].startswith('local_'): continue
    if title[i].startswith('electronic'): continue
    if title[i].startswith('dent'): continue
    if title[i].startswith('insu'): continue
    if title[i].startswith('physio'): continue
    if title[i].startswith('real'): continue
    if title[i].startswith('doc'): continue
    if title[i].startswith('storage'): continue
    if title[i].startswith('painter'): continue
    if title[i].startswith('moving'): continue
    if title[i].startswith('subway'): continue
    if title[i].startswith('meal'): continue
    if title[i].startswith('embassy'): continue
    if title[i].startswith('shoe'): continue
    
    if num > 2:
        amenities[title[i]] = num

result = []
cnt = 0

for amenity in sorted(amenities, key=lambda k: amenities[k], reverse=True):
    cnt += 1
    if cnt%4 <= 1 : continue
    result.append('{}: {}'.format(amenity,int(amenities[amenity])))
    

print result

A = result
# ---------- end amenities ----------
panel_58 = Panel(amenities.A)

# ==== cluster ModuleCenter
pt = ClusterInput()
int = ClusterInput()
num = ClusterInput()
int_2 = ClusterInput()

# ---- group: y
int_3 = Integer(int)

# ---- group: cell size
num_2 = Number(num)

# ---- group: x
int_4 = Integer(int_2)

# ---- group: center
pt_2 = Point(pt)

# ----
pt_3 = ConstructPoint(XCoordinate=0, YCoordinate=0, ZCoordinate=0)  # disabled
addition = Addition(A=int_4, B=0.5)
vec2pt = Vector2Pt(PointA=pt_3, PointB=pt_2, Unitize=False)  # -> Vector, Length; disabled
addition_2 = Addition(A=int_3, B=0.5)
multiplication = Multiplication(A=addition, B=num_2)
lng = ListLength(List=int_4)  # disabled
move = Move(Motion=vec2pt.Vector)  # -> Geometry, Transform; disabled
multiplication_2 = Multiplication(A=addition_2, B=num_2)
X = UnitX(Factor=multiplication)
repeat = RepeatData(Data=move.Transform, Length=lng)  # disabled
neg = Negative(Value=multiplication_2)
move_2 = Move(Geometry=pt_2, Motion=X)  # -> Geometry, Transform
graft = GraftTree(Tree=move_2.Transform, IncludeEmptyLists=True, IncludeNullItems=True)  # disabled
Y = UnitY(Factor=neg)
pshift = ShiftPaths(Data=repeat, Offset=-1)  # disabled
move_3 = Move(Geometry=move_2.Geometry, Motion=Y)  # -> Geometry, Transform
graft_2 = GraftTree(Tree=move_3.Transform, IncludeEmptyLists=True, IncludeNullItems=True)  # disabled
comp = Compound(Transforms=[graft, graft_2])  # disabled
graft_3 = GraftTree(Tree=pshift, IncludeEmptyLists=True, IncludeNullItems=True)  # disabled
comp_2 = Compound(Transforms=[comp, graft_3])  # disabled

# ---- group: module center
pt_4 = Point(move_3.Geometry)

# ----
pshift_2 = ShiftPaths(Data=comp_2, Offset=-1)  # disabled
transform = Transform(pshift_2)  # disabled
pt_5 = ClusterOutput(pt_4)
transform_2 = ClusterOutput(transform)  # disabled

# ==== cluster MoveToOrgin
num = ClusterInput()
G = ClusterInput()
num_2 = Number(num)
geobottomcenter = GeoBottomCenter(geo=G)
vec2pt = Vector2Pt(PointA=geobottomcenter, PointB=Point(0, 0, 0), Unitize=False)  # -> Vector, Length
move = Move(Geometry=G, Motion=vec2pt.Vector)  # -> Geometry, Transform
scale_nu = ScaleNU(Geometry=move.Geometry, Plane=PlaneXY(0, 0, 0), ScaleX=num_2, ScaleY=num_2, ScaleZ=1)  # -> Geometry, Transform
G_2 = ClusterOutput(scale_nu.Geometry)

# ==== cluster GeoBottomCenter_2
geo = ClusterInput()
geo_2 = Geometry(geo)
bbox = BoundingBox(Content=geo_2, Plane=PlaneXY(0, 0, 0))  # -> Box, Box_2
box_corners = BoxCorners(Box=bbox.Box)  # -> CornerA, CornerB, CornerC, CornerD, CornerE, CornerF, CornerG, CornerH
pdecon = Deconstruct(Point=box_corners.CornerA)  # -> XComponent, YComponent, ZComponent
pdecon_2 = Deconstruct(Point=box_corners.CornerC)  # -> XComponent, YComponent, ZComponent
addition = Addition(A=pdecon.XComponent, B=pdecon_2.XComponent)
addition_2 = Addition(A=pdecon.YComponent, B=pdecon_2.YComponent)
division = Division(A=addition, B=2)
division_2 = Division(A=addition_2, B=2)
pt = ConstructPoint(XCoordinate=division, YCoordinate=division_2, ZCoordinate=pdecon.ZComponent)
pshift = ShiftPaths(Data=pt, Offset=-1)
pt_2 = Point(pshift)
pt_3 = ClusterOutput(pt_2)

# ==== cluster GeoBottomCenter
geo = ClusterInput()
geo_2 = Geometry(geo)
bbox = BoundingBox(Content=geo_2, Plane=PlaneXY(0, 0, 0))  # -> Box, Box_2
box_corners = BoxCorners(Box=bbox.Box)  # -> CornerA, CornerB, CornerC, CornerD, CornerE, CornerF, CornerG, CornerH
pdecon = Deconstruct(Point=box_corners.CornerA)  # -> XComponent, YComponent, ZComponent
pdecon_2 = Deconstruct(Point=box_corners.CornerC)  # -> XComponent, YComponent, ZComponent
addition = Addition(A=pdecon.XComponent, B=pdecon_2.XComponent)
addition_2 = Addition(A=pdecon.YComponent, B=pdecon_2.YComponent)
division = Division(A=addition, B=2)
division_2 = Division(A=addition_2, B=2)
pt = ConstructPoint(XCoordinate=division, YCoordinate=division_2, ZCoordinate=pdecon.ZComponent)
pt_2 = Point(pt)
pt_3 = ClusterOutput(pt_2)
